# Grasshopper definition Mastalski_assignment.gh (Grasshopper 1.0.7)
# plug-ins: Kangaroo2 Components

# ---- group: RH_IN:radius
radius = Slider(8, range=5..20)

# ---- group: RH_IN:count
count = Slider(5, range=2..20)

# ---- group: RH_IN:proportion
count_2 = Slider(10, range=2..20)

# ----
remap_numbers = RemapNumbers(Value=count_2, Source="2 to 20", Target="0.5 to 1.2")  # -> Mapped, Clipped
sph = Sphere(Base=PlaneXY(0, 0, 0), Radius=radius)
multiplication = Multiplication(A=count, B=remap_numbers.Mapped)
panel = Panel(remap_numbers.Clipped)
panel_2 = Panel(remap_numbers.Mapped)
pt = ConstructPoint(XCoordinate=0, YCoordinate=0, ZCoordinate=0)
popgeo = PopulateGeometry(Geometry=sph, Count=count, Seed=1)
division = Division(A=radius, B=multiplication)
flip_mesh = FlipMesh(VertexNormals=True, FaceNormals=True, FaceOrientation=True)
panel_3 = Panel(division)
construct_domain = ConstructDomain(DomainStart=0, DomainEnd=1)
ln = Line(StartPoint=pt, EndPoint=popgeo)
face_normals = FaceNormals()  # -> Centers, Normals
mp = MultiPipe(Curves=ln, NodeSize=division, EndOffset=1, StrutSize=expr("x*1.15", division), Segment=0, KinkAngle=0.6, CubeFit=0)
meshsubd = MeshFromSubD(SubD=mp, Density=2)
mesh = Data(meshsubd)
mesh_caps = MeshCaps(M=mesh, W=True, O=True, D=0)  # -> out, A, E; inputs M: Mesh, clr: Color
# ---------- mesh_caps: VB ----------
    Component.Params.Input(0).Name = "Mesh"
    Component.Params.Input(0).Description = "An open mesh"
    Component.Params.Input(1).Name = "Join and Weld"
    Component.Params.Input(1).Description = "If true the original mesh will be joined and welded to the new caps, else the caps will be output as a list of new meshes"
    Component.Params.Input(2).Name = "Simplify Faces"
    Component.Params.Input(2).Description = "If true, naked edges consisting of 3 to 4 segments will be replaced with a single face, else faces will use new center vertex method"
    Component.Params.Input(3).Name = "Distance (Optional, Rhino Units)"
    Component.Params.Input(3).Description = "A single number which sets the Rhino unit based distance that the center point will be offset from the vertex averages"

    Component.Params.Output(1).Name = "Mesh"
    Component.Params.Output(1).Description = "If successful, a list or single of valid meshes"
    Component.Params.Output(2).Name = "Polylines"
    Component.Params.Output(2).Description = "If successful, a list of valid edge polylines"

    If M IsNot Nothing Then
      Dim i,j,k,kk,ka As Integer
      Dim arrP() As polyline
      Dim P As polyline
      Dim arrM As New list(Of Mesh)
      Dim mj As New mesh
      Dim clrB,clrC,blnN() As Boolean
      Dim oc,tcc As New list(Of color)
      If (clr <> Nothing) Then clrC = True
      If ((m.VertexColors.count() > 0) Or (clr <> Nothing)) Then clrB = True
      If (m.VertexColors.count() = 0) Then  m.vertexcolors.CreateMonotoneMesh(color.LightGray)
      oc = m.VertexColors.ToArray.tolist()
      Dim mv() As point3d
      Dim mo As New list(Of mesh)
      Dim fc As New list(Of MeshFace)
      Dim np As New list(Of point3d)
      Dim ni As New list(Of Integer)
      Dim ind(3) As Integer

      mv = m.Vertices.ToPoint3dArray()
      blnN = m.GetNakedEdgePointStatus()
      arrP = m.GetNakedEdges()

      For i = 0 To ubound(blnN) Step 1
        If blnN(i) Then
          np.add(mv(i))
          ni.add(i)
        End If
      Next

      Dim cld As New pointcloud(np.toarray())
      For i = 0 To ubound(arrP) Step 1
        Dim tm As New mesh
        tm.Vertices.Clear()
        tm.Faces.Clear()

        p = arrP(i)
        If (O And (p.count() < 6)) Then
          ind(0) = ni(cld.ClosestPoint(p(0)))
          ind(1) = ni(cld.ClosestPoint(p(1)))
          ind(2) = ni(cld.ClosestPoint(p(2)))
          ind(3) = ni(cld.ClosestPoint(p(3)))
          tm.Vertices.Add(mv(ind(0)))
          tm.Vertices.Add(mv(ind(1)))
          tm.Vertices.Add(mv(ind(2)))

          tm.VertexColors.Add(oc(ind(0)))
          tm.VertexColors.Add(oc(ind(1)))
          tm.VertexColors.Add(oc(ind(2)))
          If p.count() = 5 Then
            fc.add(New meshface(ind(0), ind(1), ind(2), ind(3)))
            tm.Vertices.Add(mv(ind(3)))
            tm.VertexColors.Add(oc(ind(3)))
            tm.Faces.addface(New meshface(0, 1, 2, 3))
          ElseIf p.count() = 4 Then
            fc.add(New meshface(ind(0), ind(1), ind(2)))
            tm.Faces.addface(New meshface(0, 1, 2))
          End If
          tm.FaceNormals.ComputeFaceNormals()
          tm.Normals.ComputeNormals()
          mo.add(tm)

        Else
          Dim tx As New mesh
          Dim vec As New vector3d
          Dim tv As New list(Of point3d)
          Dim tc As New list(Of color)
          Dim tfc As New list(Of meshface)
          Dim r,g,b As Integer
          Dim tcl As color
          k = cld.ClosestPoint(p(0))
          ka = k
          tx.Vertices.AddVertices(p.ToArray())
          tx.Faces.AddFaces(p.TriangulateClosedPolyline())
          tx.Normals.ComputeNormals()

          vec = tx.Normals(0)

          tv.add(p(0))
          tc.add(oc(k))
          r = oc(ni(k)).R
          g = oc(ni(k)).G
          b = oc(ni(k)).B
          For j = 1 To p.count() - 2 Step 1
            kk = cld.ClosestPoint(p(j))
            fc.add(New meshface(m.Vertices.count(), ni(k), ni(kk)))
            vec += tx.Normals(j)
            k = kk

            tv.add(p(j))
            tc.add(oc(k))
            r += oc(ni(k)).R
            g += oc(ni(k)).G
            b += oc(ni(k)).B
            tfc.add(New meshface(p.count() - 1, j - 1, j))
          Next
          fc.add(New meshface(m.Vertices.count(), ni(k), ni(ka)))
          vec.Unitize()
          vec *= D
          m.Vertices.add(p.CenterPoint() + vec)

          r /= (p.count() - 1)
          g /= (p.count() - 1)
          b /= (p.count() - 1)
          If r > 255 Then r = 255 Else If r < 0 Then r = 0
          If g > 255 Then g = 255 Else If g < 0 Then g = 0
          If b > 255 Then b = 255 Else If b < 0 Then b = 0
          If clrC Then tcl = clr Else tcl = color.FromArgb(r, g, b)
          m.VertexColors.Add(tcl)

          tv.add(p.CenterPoint() + vec)
          tc.add(tcl)
          tfc.add(New meshface(p.count() - 1, p.count() - 2, 0))
          tm.vertices.AddVertices(tv.toarray())
          If clrB Then tm.VertexColors.AppendColors(tc.toarray())
          tm.faces.addfaces(tfc)
          tm.FaceNormals.ComputeFaceNormals()
          tm.Normals.ComputeNormals()
          mo.add(tm)
        End If
      Next

      If w Then
        m.Faces.AddFaces(fc)
        m.FaceNormals.ComputeFaceNormals()
        m.UnifyNormals()
        m.Normals.ComputeNormals()
        If Not clrB Then m.VertexColors.Clear()
        A = m
      Else
        A = mo
      End If
      E = arrP
    End If
# ---------- mesh_caps: VB additional code ----------
  Private Function avgC(ByVal R As Double, ByVal G As Double, ByVal B As Double, ByVal T As Integer)

    R /= t
    G /= t
    B /= t
    If R > 255 Then R = 255 Else If R < 0 Then R = 0
    If G > 255 Then G = 255 Else If G < 0 Then G = 0
    If B > 255 Then B = 255 Else If B < 0 Then B = 0

    Return color.FromArgb(CInt(R), CInt(G), CInt(B))
  End Function
# ---------- end mesh_caps ----------
weld_mesh = WeldMesh(Mesh=mesh_caps.A, Angle=3.141592654)
label_face = LabelFace(M=mesh)  # -> out, A, B; inputs M: Mesh
# ---------- label_face: VB ----------
    Component.Params.Input(0).Name = "Mesh"
    Component.Params.Input(0).Description = "Open or closed mesh"
    Component.Params.Input(1).Name = "Text Size"
    Component.Params.Input(1).Description = "Optional input that sets the size of the text object, if blank the size will be averaged from the face"

    Component.Params.Output(1).Name = "Point"
    Component.Params.Output(1).Description = "The plane at the center of the text object"
    Component.Params.Output(2).Name = "Index"
    Component.Params.Output(2).Description = "The mesh face indices"

    'visualization code adapted From work By David Rutten: http://www.grasshopper3d.com/forum/topics/disabling-preview-For-certain - outputs - -a - custom - gh - component
    If m Is Nothing Then m = New mesh
    If (runCount = 0) Then
      tags = New List(Of Rhino.Display.Text3d)
      box = BoundingBox.Empty
      Dim component As IGH_Component = DirectCast(owner, IGH_Component)
      Dim param As IGH_Param = component.Params.Output(1)
      Dim prvObject As IGH_PreviewObject = TryCast(param, IGH_PreviewObject)
      If (prvObject IsNot Nothing) Then prvObject.Hidden = True
    End If
    If (Not m.IsValid) Then Return

    Dim i As Integer
    Dim plnOut As New list(Of plane)
    Dim idxOut As New list(Of Integer)

    For i = 0 To m.Faces.Count() - 1 Step 1

      Dim pln As New plane(incircle(m.vertices.item(m.Faces.item(i).C), m.vertices.item(m.Faces.item(i).A), m.vertices.item(m.Faces.item(i).B))(0))
      pln.Origin = m.Faces.GetFaceCenter(i)
      Dim rad,trd As Double

      If s = Nothing Then
        rad = (incircle(m.vertices.item(m.Faces.item(i).C), m.vertices.item(m.Faces.item(i).A), m.vertices.item(m.Faces.item(i).B))(1))
      Else
        rad = s
      End If

      plnOut.add(pln)
      trd = rad * ( 1.25 / (CStr(i).length))
      Dim arrPt() As point3d
      Dim ttag As New Rhino.Display.Text3d(String.Format("{0:0}", i), plane.WorldXY, trd)
      arrPt = ttag.BoundingBox.GetCorners()

      pln.Origin = pln.Origin - ( pln.YAxis * (arrPt(0).distanceto(arrPt(3)) / 2)) - ( pln.XAxis * (arrPt(0).distanceto(arrPt(1)) / 2))

      Dim tag As New Rhino.Display.Text3d(String.Format("{0:0}", i), pln, trd)

      tags.Add(tag)
      idxOut.add(i)
      box.Union(tag.BoundingBox)
    Next
    A = plnOut
    B = idxOut
# ---------- label_face: VB additional code ----------
  Private tags As List(Of Rhino.Display.Text3d)
  Private box As BoundingBox

  'Return a BoundingBox that contains all the geometry you are about to draw.
  Public Overrides ReadOnly Property ClippingBox() As BoundingBox
    Get
      Return box
    End Get
  End Property

  'Draw all meshes in this method.
  Public Overrides Sub DrawViewportMeshes(ByVal args As IGH_PreviewArgs)
  End Sub

  'Draw all wires and points in this method.
  Public Overrides Sub DrawViewportWires(ByVal args As IGH_PreviewArgs)
    If (tags Is Nothing) Then Return
    If (owner.Attributes.Selected ) Then
      For Each tag As Rhino.Display.Text3d In tags
        args.Display.Draw3dText(tag, args.WireColour_Selected)
      Next
    Else
      For Each tag As Rhino.Display.Text3d In tags
        args.Display.Draw3dText(tag, args.WireColour)
      Next
    End If
  End Sub

  Function incircle(ByVal ptA As point3d, ByVal ptb As point3d, ByVal ptC As point3d)
    Dim A, B, D As Double
    Dim rad, pa, s As Double
    Dim x, y, z As Double


    a = ptB.DistanceTo(ptC)
    b = ptA.DistanceTo(ptC)
    d = ptA.DistanceTo(ptB)

    s = (a + b + d) / 2
    pa = math.Sqrt(s * ((s - a) * (s - b) * (s - d)))

    rad = 2 * pa / (a + b + d)

    x = (ptA.x * A + ptB.x * B + ptC.x * D) / (A + B + D)
    y = (ptA.y * A + ptB.y * B + ptC.y * D) / (A + B + D)
    z = (ptA.z * A + ptB.z * B + ptC.z * D) / (A + B + D)
    Dim ptOut As New point3d(x, y, z)
    Dim plnOut As New Plane(ptOut, (ptC - ptB), (ptA - ptOut))

    Return {plnOut,rad}
  End Function
# ---------- end label_face ----------
list_length = ListLength(List=label_face.B)
label_face_2 = LabelFace(M=weld_mesh)  # -> out, A, B; inputs M: Mesh; same code as label_face
split_list = SplitList(List=label_face_2.B, Index=list_length)  # -> ListA, ListB
split_list_2 = SplitList(List=label_face_2.A, Index=list_length)  # -> ListA, ListB
distance = Distance(PointA=pt, PointB=split_list_2.ListB)
number_slider = Slider(0.22, range=0.1..10)
remap = Remap(data=distance, min=Slider(0.1, range=0.1..10), max=Slider(3.76, range=0.1..10))  # -> flatten(R)
preview = CustomPreview(Geometry=mesh, Material=ColourSwatch(SwatchColor=RGB(255, 255, 255)))
crystalize = Crystalize(G=weld_mesh, I=split_list.ListB, L=Slider(1, range=0..10), C=False, D=remap, X=0.5, t0=0.5)  # -> out, A; inputs G: GeometryBase, I: list, L: list, C: list, D: list, X: list, t0: list, clr: list of Color
# ---------- crystalize: VB ----------
    Component.Params.Input(0).Name = "Mesh or Curve"
    Component.Params.Input(0).Description = "Open or closed mesh or curve"
    Component.Params.Input(1).Name = "Index [Face]"
    Component.Params.Input(1).Description = "An optional index or list of indices which specify which faces are to be modified. If empty, all faces will be used"
    Component.Params.Input(2).Name = "Loops [Face]"
    Component.Params.Input(2).Description = "An optional list of integer values which sets the number of iterative operations to be applied to each face"
    Component.Params.Input(3).Name = "Close [Face]"
    Component.Params.Input(3).Description = "An optional list of boolean values which closes the face it true"
    Component.Params.Input(4).Name = "Distance [Face, Rh Units]"
    Component.Params.Input(4).Description = "An optional list of double values which sets depth the new geometry will be offset from the original face"
    Component.Params.Input(5).Name = "Multiplier [Face]"
    Component.Params.Input(5).Description = "An optional list of double values which is a per loop multiplier for the Distance value"
    Component.Params.Input(6).Name = "Edge Offset [Face]"
    Component.Params.Input(6).Description = "Evaluation from the edge vertex to the center of the face"
    Component.Params.Input(7).Name = "Colors [Vertex]"
    Component.Params.Input(7).Description = "(If applied to a mesh a list of colors corresponding to each mesh face, if applied to a curve, a list of colors corresponding to each control point plus an additonal color value for the new averaged center"

    Component.Params.Output(1).Name = "Mesh"
    Component.Params.Output(1).Description = "If successful, a valid mesh"

    If g IsNot Nothing Then

      Dim j,k,kk,n,t,tt,v,w,Lt,lp,cnt As Integer
      Dim arrL() As Integer
      arrL = L.toarray()
      array.Sort(arrL)
      Lt = arrL(ubound(arrL))

      For lp = 0 To Lt Step 1
        Dim u() As Integer = Nothing
        Dim tint() As Integer = Nothing
        Dim mo As New mesh
        Dim ov,cv As New list(Of Point3d)
        Dim ofc As New list(Of meshface)
        Dim oc, oca As New list(Of color)

        Dim otx, ot0, od As New list(Of Double)
        Dim oL As New list(Of Integer)
        Dim oi As New list(Of Integer)

        Dim blnM, blnC As Boolean

        Dim cen As point3d
        Dim vec As Vector3d
        Dim clrB,clrL As Boolean
        Dim avgClr,avgClrC As color

        blnM = g.ObjectType = ObjectType.Mesh
        blnC = g.ObjectType = ObjectType.Curve

        'Declare Mesh Variables
        Dim m As mesh
        Dim mf As Rhino.Geometry.Collections.MeshFaceList = Nothing
        Dim mv As Rhino.Geometry.Collections.MeshVertexList = Nothing
        Dim mtv As Rhino.Geometry.Collections.MeshTopologyVertexList = Nothing
        Dim mn As Rhino.Geometry.Collections.MeshFaceNormalList = Nothing
        Dim mc As Rhino.Geometry.Collections.MeshVertexColorList

        'Declare Curve Variables
        Dim crv As curve
        Dim ncrv As nurbsCurve
        Dim npts As rhino.Geometry.Collections.NurbsCurvePointList
        Dim vs() As vector3f

        If (blnM Or blnC) Then

          If blnM Then
            'Start Deconstruct if Mesh
            m = g
            m.Normals.ComputeNormals()
            m.FaceNormals.ComputeFaceNormals()
            mf = m.Faces
            mv = m.Vertices
            mtv = m.TopologyVertices
            mn = m.FaceNormals
            mc = m.VertexColors

            'Check Mesh Color Status
            If ((m.VertexColors.count() <> 0) Or (clr.count() <> 0)) Then clrB = True
            If ((m.VertexColors.count() = 0) And (clr.count() <> 0)) Then mc.CreateMonotoneMesh(color.LightGray)

            'Populate Vertex/ Color Lists
            ov = mv.ToPoint3dArray().ToList()
            oc = mc.ToArray().ToList()
            oca = mc.ToArray().ToList()

          Else
            'Start Deconstruct if Curve
            crv = g
            ncrv = crv.ToNurbsCurve()
            npts = ncrv.Points
            Dim pline As Polyline = ncrv.Points.ControlPolygon
            Dim cmsh As New mesh
            cmsh.Vertices.AddVertices(pline.ToArray())
            cmsh.faces.addfaces(pline.TriangulateClosedPolyline())
            cmsh.Vertices.Remove(pline.count() - 1, True)
            cmsh.Normals.ComputeNormals()
            cmsh.Normals.UnitizeNormals

            ov = pline.ToArray().ToList()
            cv = pline.ToArray().ToList()
            If crv.IsClosed() Then ov.RemoveAt(pline.count() - 1)

            v = ov.Count() - 1
            If Not crv.IsClosed() Then v += 1
            u = appendprepend(v)
            w = v
            vs = cmsh.Normals.ToArray()

            For j = 0 To v Step 1
              vec += vs(u(j))
              If (clr.count() > 0) Then If j > (clr.count() - 1) Then oc.add(clr.item(clr.count() - 1)) Else oc.add(clr.item(j))
            Next
            vec /= v
            vec.Unitize
            cen = pline.CenterPoint
          End If
          'Check clr input status
          If clr.count() <> 0 Then clrB = True
        End If

        If blnM Then If i.count() > 0 Then cnt = i.count() Else cnt = mf.count() Else cnt = 1
        If lp > 0 Then clrL = False Else If clr.count() > 0 Then clrL = True Else clrL = False
        For n = 0 To cnt - 1 Step 1
          If blnM Then
            If i.count() > 0 Then j = i.item(n) Else j = n

            tint = mf.GetTopologicalVertices(j)
            cen = mf.GetFaceCenter(j)
            vec = mn.item(j)

            If mf(j).isquad() Then v = 3 Else v = 2
            u = appendprepend(v)
            w = ov.count() - 1
          Else
            j = n
          End If
          vec.Unitize()


          t = 1

          Dim la,da,ta0,tX As Double
          Dim ca As Boolean

          If j > (L.count() - 1) Then la = L.item(L.count() - 1) Else la = L.item(j)
          If j > (c.count() - 1) Then ca = c.item(c.count() - 1) Else ca = c.item(j)
          If j > (d.count() - 1) Then da = d.item(d.count() - 1) Else da = d.item(j)
          If j > (X.count() - 1) Then tX = X.item(X.count() - 1) Else tX = X.item(j)
          If j > (t0.count() - 1) Then ta0 = t0.item(t0.count() - 1) Else ta0 = t0.item(j)

          If clrB Then
            Dim tv As Integer
            Dim aR,aG,aB,bR,bG,bB As New Double
            For k = 0 To v Step 1
              If blnM Then tv = mtv.MeshVertexIndices(tint(k))(0) Else tv = k
              aR += oc.item(tv).R
              aG += oc.item(tv).G
              aB += oc.item(tv).B
              If ((lp = 0) And (clr.count() > 0)) Then
                If tv > (clr.count() - 1) Then tv = clr.count() - 1
                bR += clr.item(tv).R
                bG += clr.item(tv).G
                bB += clr.item(tv).B
              End If
            Next

            If (blnM Or ((clr.count() - 1) <= v)) Then avgClr = avgC(aR, aG, aB, v + 1) Else avgClr = clr.item(clr.count() - 1)
            If (blnM Or ((clr.count() - 1) <= v)) Then avgClrC = avgC(bR, bG, bB, v + 1) Else avgClrC = clr.item(clr.count() - 1)
          End If

          For k = 1 To v + 1  Step 1
            'Keep distance and t values from exceeding list lengths
            Dim p(1) As point3d
            Dim tv(1) As Integer

            For kk = 0 To 1 Step 1
              If blnM Then
                tv(kk) = mtv.MeshVertexIndices(tint(u(k + kk)))(0)
                p(kk) = New point3d(mv(tv(kk)))
              Else
                tv(kk) = u(k + kk)
                p(kk) = New point3d(ov(tv(kk)))
              End If

            Next

            'Define Vertices
            Dim pA(1),pB(1),pC As point3d
            Dim tpt As point3d
            pC = (p(0) + p(1)) / 2

            tpt = evalP(p(0), cen , ta0)

            If la >= lp Then
              ov.add(tpt + vec * da)
              If clrB Then
                If clrL Then If tv(0) > (clr.count() - 1) Then oc.add(clr.item(clr.count() - 1)) Else oc.add(clr.item(tv(0))) Else oc.add(evalC(oc.item(tv(0)), avgClr, ta0))
              End If
              'Define Faces
              ofc.Add(New meshface(tv(0), tv(1), w + u(k + 1) * t + 1, w + u(k) * t + 1))

              If v > 3 Then
                If ca Then ofc.Add(New meshface(w + t * (v + 1) + 1, w + u(k - 1) * t + 1, w + u(k) * t + 1))
                If ca Then tt = 1
              Else
                tt = 0
              End If
            Else
              ofc.Add(mf.item(j))
              tt = 0
            End If

            For kk = 0 To tt Step 1
              oL.add(la)
              oi.add(oi.count())
              od.add(da * tx)
              otx.add(tx)
              ot0.add(ta0)
            Next
          Next

          If la >= lp Then
            If ca Then
              If v = 2 Then
                ofc.Add(New meshface(ov.count() - 3, ov.count() - 2, ov.count() - 1))
              ElseIf v = 3 Then
                ofc.Add(New meshface(ov.count() - 4, ov.count() - 3, ov.count() - 2, ov.count() - 1))
              ElseIf v > 3 Then
                ov.add(cen + (vec * da))
                If clrB Then If clr.count() > 0 Then oc.add(avgClrC) Else oc.add(avgClr)
              End If

              If ((v > 1) And (v < 4)) Then
                oL.add(la)
                oi.add(oi.count())
                od.add(da * tx)
                otx.add(tx)
                ot0.add(ta0)
              End If
            End If
          End If
        Next

        mo.Vertices.AddVertices(ov.toarray())
        If clrB Then mo.VertexColors.AppendColors(oc.toarray())
        mo.Faces.AddFaces(ofc.toarray())

        I = oi
        L = oL
        D = od
        X = otx
        t0 = ot0
        G = mo

        A = mo
      Next

    End If
# ---------- crystalize: VB additional code ----------
  Private Function appendprepend(ByVal i As Integer)
    Dim srsEnum As IEnumerable(Of Integer) = Enumerable.Range(0, i + 1)
    Dim arrVal As New list(Of Integer)
    arrVal = srsEnum.tolist()
    arrVal.add(0)
    arrVal.insert(0, i)
    Return arrVal.toarray()
  End Function

  Private Function evalP(ByVal op As point3d, ByVal tp As Point3d, ByVal t As Double)

    Return New point3d(op + (tp - op) * t)
  End Function

  Private Function evalC(ByVal oc As color, ByVal tc As color, ByVal t As Double)
    Dim r,g,b As Integer
    r = CInt(CInt(oc.R) + (CInt(tc.R) - CInt(oc.R)) * t)
    g = CInt(CInt(oc.G) + (CInt(tc.G) - CInt(oc.G)) * t)
    b = CInt(CInt(oc.B) + (CInt(tc.B) - CInt(oc.B)) * t)

    If r > 255 Then r = 255 Else If r < 0 Then r = 0
    If g > 255 Then g = 255 Else If g < 0 Then g = 0
    If b > 255 Then b = 255 Else If b < 0 Then b = 0

    Return color.FromArgb(r, g, b)
  End Function

  Private Function avgC(ByVal R As Double, ByVal G As Double, ByVal B As Double, ByVal T As Integer)

    R /= t
    G /= t
    B /= t
    If R > 255 Then R = 255 Else If R < 0 Then R = 0
    If G > 255 Then G = 255 Else If G < 0 Then G = 0
    If B > 255 Then B = 255 Else If B < 0 Then B = 0

    Return color.FromArgb(CInt(R), CInt(G), CInt(B))
  End Function
# ---------- end crystalize ----------
antisnub = Antisnub(G=weld_mesh, I=split_list.ListB, T0=0.5, T1=0.5, T2=0.5, T3=0.5, T4=0.5, T5=0, D=division, C=Toggle(True))  # -> out, A; inputs G: GeometryBase, I: list, T0: list, T1: list, T2: list, T3: list, T4: list, T5: list, D: list, clr: list of Color
# ---------- antisnub: VB ----------
    Component.Params.Input(0).Name = "Mesh or Curve"
    Component.Params.Input(0).Description = "Open or closed mesh or curve"
    Component.Params.Input(1).Name = "Index [Face]"
    Component.Params.Input(1).Description = "An optional integer or list of integers which specify the faces to be modified if the input is a mesh. If no value is supplied then all faces will be modified"
    Component.Params.Input(2).Name = "Edge to Face [Vertex]"
    Component.Params.Input(2).Description = "A unitized value which moves a new vertex between the edge midpoint and face center"
    Component.Params.Input(3).Name = "Base Closure [Vertex]"
    Component.Params.Input(3).Description = "A unitized value closes the opening of the stellation from the edge to the peak"
    Component.Params.Input(4).Name = "Peak Closure [Vertex]"
    Component.Params.Input(4).Description = "A unitized value closes the opening of the stellation from the peak to the edge"
    Component.Params.Input(5).Name = "Base Edge [Vertex]"
    Component.Params.Input(5).Description = "A unitized value which moves a new vertex along the offset base edge towards the midpoint"
    Component.Params.Input(6).Name = "Peak Edge [Vertex]"
    Component.Params.Input(6).Description = "A unitized value which moves a new vertex along the offset peak edge towards the midpoint"
    Component.Params.Input(7).Name = "Closed Depth [Vertex]"
    Component.Params.Input(7).Description = "If C is true, then this unitized value will set the offset depth of the new center point relative to the face's relief depth"
    Component.Params.Input(8).Name = "Distance [Vertex]"
    Component.Params.Input(8).Description = "An optional number or list of numbers which specifies the depth of the relief from the mesh face"
    Component.Params.Input(9).Name = "Close"
    Component.Params.Input(9).Description = "If true, the truncated stellations will be closed with a quad face"
    Component.Params.Input(10).Name = "Color [Vertex]"
    Component.Params.Input(10).Description = "(If applied to a mesh a list of colors corresponding to each mesh face, if applied to a curve, a list of colors corresponding to each control point plus an additonal color value for the new averaged center"

    Component.Params.Output(1).Name = "Mesh"
    Component.Params.Output(1).Description = "If successful, a valid mesh"

    If G IsNot Nothing Then

      Dim bM, bP,bmC,biC As Boolean

      bM = g.ObjectType = ObjectType.Mesh
      bP = g.ObjectType = ObjectType.Curve

      If (bM Or bP) Then
        Dim msh As New mesh
        Dim crv As curve
        Dim av As point3d
        Dim ac As color
        Dim h,j,jj,k,u,v,w As Integer
        Dim cv,cf,ce As Integer
        Dim x(),y() As Integer

        Dim mv,fv,ep,tv As New list(Of Point3d)
        Dim mev As New dictionary(Of String, Integer)
        Dim mf As Rhino.Geometry.Collections.MeshFaceList = Nothing
        Dim mtv As Rhino.Geometry.Collections.MeshTopologyVertexList = Nothing
        Dim mte As Rhino.Geometry.Collections.MeshTopologyEdgeList = Nothing
        Dim mn As Rhino.Geometry.Collections.MeshVertexNormalList = Nothing
        Dim mfn As Rhino.Geometry.Collections.MeshFaceNormalList = Nothing
        Dim ev As New list(Of vector3d)
        Dim ed As New list(Of Double)
        Dim mc,ec,tc,cc,fc As New list(Of color)
        Dim xf As New list(Of meshface)

        If clr.count() = 0 Then clr.add(color.LightGray) Else biC = True

        If bm Then
          'Start Deconstruct if Mesh
          msh = g

          If msh.Normals.Count() = 0 Then msh.Normals.ComputeNormals()
          If msh.FaceNormals.Count() = 0 Then msh.FaceNormals.ComputeFaceNormals()

          If i.count() = 0 Then I = Enumerable.Range(0, msh.Faces.Count()).ToList()

          mv = msh.Vertices().ToPoint3dArray().tolist()
          mte = msh.TopologyEdges()
          mtv = msh.TopologyVertices()
          mf = msh.Faces()

          mn = msh.Normals()
          mn.UnitizeNormals()
          mfn = msh.FaceNormals()
          mfn.UnitizeFaceNormals()

          cf = I.Count() - 1
          ce = mte.count() - 1

          'Assign Colors
          If msh.VertexColors.Count() < 1 Then
            msh.VertexColors.CreateMonotoneMesh(color.LightGray)
            bmC = biC
          Else
            bmC = True
          End If
          'Assign fake edges
          mc = msh.VertexColors().ToArray().ToList()
        Else
          'Start Deconstruct if Curve
          crv = g

          I.clear()
          I.add(0)
          Dim nc As nurbscurve
          Dim pc As polyline
          Dim nps As Rhino.Geometry.Collections.NurbsCurvePointList

          nc = crv.ToNurbsCurve()
          nps = nc.Points
          pc = nc.Points.ControlPolygon
          If (Not pc.IsClosed) Then pc.add(pc(0))
          av = pc.CenterPoint

          msh.Vertices.AddVertices(pc.ToArray())
          msh.faces.addfaces(pc.TriangulateClosedPolyline())
          msh.Vertices.Remove(pc.count() - 1, True)
          msh.FaceNormals.ComputeFaceNormals()
          msh.Normals.ComputeNormals()
          msh.Normals.UnitizeNormals()

          mv = msh.Vertices.ToPoint3dArray().tolist()
          mte = msh.TopologyEdges()
          mtv = msh.TopologyVertices()
          mn = msh.Normals()
          mfn = msh.FaceNormals()

          mfn(0) = avgVec(mn.toarray())

          'Assign Colors
          If bic Then bmC = True
          mc = clr
          If (clr.count() - 1) < (mv.count() - 1) Then mc = matchClr(mc, mv.count() - 1)


          ac = avgClr(mc.toarray())
          cf = 0
        End If
        cv = mv.count() - 1
        ce = mte.count() - 1

        x = appendprepend(cv)
        'Match variables and colors to vertex count
        If (T0.count() - 1) < cv Then T0 = matchDbl(T0, cv)
        If (T1.count() - 1) < cv Then T1 = matchDbl(T1, cv)
        If (T2.count() - 1) < cv Then T2 = matchDbl(T2, cv)
        If (T3.count() - 1) < cv Then T3 = matchDbl(T3, cv)
        If (T4.count() - 1) < cv Then T4 = matchDbl(T4, cv)
        If (T5.count() - 1) < cv Then T5 = matchDbl(T5, cv)
        If (D.count() - 1) < cv Then D = matchDbl(D, cv)
        If (clr.count() - 1) < cv Then clr = matchClr(clr, cv)
        If biC Then fc = clr Else fc = mc

        'Edge based vertices
        k = 0
        For j = 0 To mte.count() - 1 Step 1
          If (bm Or (bp And (mte.GetConnectedFaces(j).Count() < 2))) Then
            u = mtv.MeshVertexIndices(mte.GetTopologyVertices(j).I)(0)
            v = mtv.MeshVertexIndices(mte.GetTopologyVertices(j).J)(0)

            ep.add(evalP(mv(u), mv(v), 0.5))
            ev.add(evalV(mn(u), mn(v), 0.5))
            ed.add(evalN(d(u), d(v), 0.5))
            ec.add(evalC(mc(u), mc(v), 0.5))
            mev.add(u & "," & v & "," & 0, k)
            mev.add(v & "," & u & "," & 0, k)

            k += 1
          End If
        Next

        'Face based vertices
        Dim xv(),mt(),ei() As Integer
        Dim xc() As color
        Dim xd,xn As Double
        ReDim ei(0)
        u = 4
        v = mv.count() + cf + 1

        For jj = 0 To I.count() - 1 Step 1
          Dim tcv As New point3d
          j = I(jj)
          w = v + tv.count()
          xd = 0
          xn = 0
          If bm Then
            If mf(j).isquad() Then h = 4 Else h = 3
            ReDim xv(h - 1)
            ReDim xc(h - 1)
            mt = mf.GetTopologicalVertices(j)
            For k = 0 To h - 1 Step 1
              xv(k) = mtv.MeshVertexIndices(mt(k))(0)
              xc(k) = fc(xv(k))
            Next
            av = mf.GetFaceCenter(j)
            ac = avgClr(xc)
          Else
            h = mv.count()
            xv = Enumerable.Range(0, h).ToArray()
          End If
          For k = 0 To h - 1 Step 1
            xd += D(xv(k))
            xn += T5(xv(k))
          Next
          xd /= h
          xn /= h
          mfn(j) *= xd
          y = appendprepend(h - 1)

          For k = 1 To h Step 1
            ei(0) = mev.item(xv(y(k)) & "," & xv(y(k + 1)) & "," & 0)

            Dim pnt(4) As point3d
            Dim acl(4) As color
            pnt(0) = evalP(av + mfn(j), ((mv(xv(y(k))) + mN(xv(y(k))) * D(xv(y(k)))) + (mv(xv(y(k + 1))) + mN(xv(y(k + 1))) * D(xv(y(k + 1))))) / 2, (t0(xv(y(k))) + t0(xv(y(k + 1)))) / 2)
            pnt(1) = evalP(mv(xv(y(k))), pnt(0), t1(xv(y(k))) / 2)
            pnt(2) = evalP(mv(xv(y(k + 1))), pnt(0), t1(xv(y(k + 1))) / 2)
            pnt(3) = evalP(pnt(0), mv(xv(y(k))), t2(xv(y(k))) / 2)
            pnt(4) = evalP(pnt(0), mv(xv(y(k + 1))), t2(xv(y(k + 1))) / 2)

            acl(0) = evalC(ac, mc(xv(y(k))), (t0(xv(y(k))) + t0(xv(y(k + 1)))) / 2)
            acl(1) = evalC(mc(xv(y(k))), acl(0), t1(xv(y(k))) / 2)
            acl(2) = evalC(mc(xv(y(k + 1))), acl(0), t1(xv(y(k + 1))) / 2)
            acl(3) = evalC(acl(0), mc(xv(y(k))), t2(xv(y(k))) / 2)
            acl(4) = evalC(acl(0), mc(xv(y(k + 1))), t2(xv(y(k + 1))) / 2)

            'Define new per face vertices
            tv.add(evalP(pnt(1), pnt(2), t3(xv(y(k))) / 2))
            tc.add(evalC(acl(1), acl(2), t3(xv(y(k))) / 2))

            tv.add(evalP(pnt(2), pnt(1), t3(xv(y(k + 1))) / 2))
            tc.add(evalC(acl(2), acl(1), t3(xv(y(k + 1))) / 2))

            tv.add(evalP(pnt(3), pnt(4), t4(xv(y(k))) / 2))
            tc.add(evalC(acl(3), acl(4), t4(xv(y(k))) / 2))

            tv.add(evalP(pnt(4), pnt(3), t4(xv(y(k + 1))) / 2))
            tc.add(evalC(acl(4), acl(3), t4(xv(y(k + 1))) / 2))

            tcv += (pnt(3) + pnt(4)) / 2
            'Define new faces
            xf.add(New meshface(xv(y(k)), xv(y(k + 1)), w + y(k) * u + 1, w + y(k) * u))
            xf.add(New meshface(xv(y(k)), w + y(k) * u, w + y(k - 1) * u + 1))
            xf.add(New meshface(w + y(k) * u + 2, w + y(k - 1) * u + 3, w + y(k - 1) * u + 1, w + y(k) * u))
            xf.add(New meshface(w + y(k) * u + 2, w + y(k) * u + 3, v + jj - cf - 1))
            xf.add(New meshface(w + y(k - 1) * u + 3, w + y(k) * u + 2, v + jj - cf - 1))


            If c Then
              xf.add(New meshface(w + y(k) * u + 3, w + y(k) * u + 2, w + y(k) * u, w + y(k) * u + 1))
            End If
          Next
          tcv /= h
          fv.add(evalP(tcv, av, xn))
          cc.add(ac)
        Next

        Dim om As New mesh
        om.Vertices.AddVertices(mv)
        If bmC Then om.VertexColors.AppendColors(mc.toarray())

        om.Vertices.AddVertices(fv)
        If bmC Then om.VertexColors.AppendColors(cc.toarray())

        om.Vertices.AddVertices(tv.toarray())
        If bmC Then om.VertexColors.AppendColors(tc.toarray())

        om.Faces.AddFaces(xf.toarray())

        If i.count() > 0 Then om.Vertices.CullUnused()

        A = om
      End If
    End If
# ---------- antisnub: VB additional code ----------
  Private Function appendprepend(ByVal i As Integer)
    Dim srsEnum As IEnumerable(Of Integer) = Enumerable.Range(0, i + 1)
    Dim arrVal As New list(Of Integer)
    arrVal = srsEnum.tolist()
    arrVal.add(0)
    arrVal.insert(0, i)
    Return arrVal.toarray()
  End Function

  Private Function matchDbl(ByVal a As list(Of Double), ByVal t As Integer)
    Dim i,k As Integer
    k = a.count()
    For i = 0 To ((t + 1) - k) - 1 Step 1
      a.add(a.item(k - 1))
    Next
    Return a
  End Function

  Private Function matchClr(ByVal a As list(Of Color), ByVal t As Integer)
    Dim i,k As Integer
    k = a.count()
    For i = 0 To ((t + 1) - k) - 1 Step 1
      a.add(a.item(k - 1))
    Next
    Return a
  End Function

  Private Function evalP(ByVal op As point3d, ByVal tp As Point3d, ByVal t As Double)
    Return New point3d(op + (tp - op) * t)
  End Function

  Private Function evalV(ByVal ov As vector3d, ByVal tv As vector3d, ByVal t As Double)
    Return New vector3d(ov + (tv - ov) * t)
  End Function

  Private Function evalN(ByVal u As Double, ByVal v As Double, ByVal t As Double)
    Return u + (v - u) * t
  End Function

  Private Function avgVec(ByVal v() As vector3f)
    Dim i As Integer
    Dim tv As Vector3d

    For i = 0 To ubound(v) Step 1
      tv += v(i)
    Next
    tv /= (ubound(v) + 1)
    tv.Unitize()
    Return New vector3f(tv.X, tv.Y, tv.Z)
  End Function

  Private Function roundClr(ByVal r As Integer, ByVal g As Integer, ByVal b As Integer, ByVal i As Integer)
    r = CInt(r / i)
    g = CInt(g / i)
    b = CInt(b / i)

    If r > 255 Then r = 255 Else If r < 0 Then r = 0
    If g > 255 Then g = 255 Else If g < 0 Then g = 0
    If b > 255 Then b = 255 Else If b < 0 Then b = 0

    Return color.FromArgb(r, g, b)
  End Function

  Private Function avgClr(ByVal c() As color)
    Dim r,g,b As Integer
    Dim i,k As Integer

    k = ubound(c) + 1

    For i = 0 To k - 1 Step 1
      r += CInt(c(i).R)
      g += CInt(c(i).G)
      b += CInt(c(i).B)
    Next

    r = CInt(r / k)
    g = CInt(g / k)
    b = CInt(b / k)

    If r > 255 Then r = 255 Else If r < 0 Then r = 0
    If g > 255 Then g = 255 Else If g < 0 Then g = 0
    If b > 255 Then b = 255 Else If b < 0 Then b = 0

    Return color.FromArgb(r, g, b)
  End Function

  Private Function evalC(ByVal oc As color, ByVal tc As color, ByVal t As Double)
    Dim r,g,b As Integer
    r = CInt(CInt(oc.R) + (CInt(tc.R) - CInt(oc.R)) * t)
    g = CInt(CInt(oc.G) + (CInt(tc.G) - CInt(oc.G)) * t)
    b = CInt(CInt(oc.B) + (CInt(tc.B) - CInt(oc.B)) * t)

    If r > 255 Then r = 255 Else If r < 0 Then r = 0
    If g > 255 Then g = 255 Else If g < 0 Then g = 0
    If b > 255 Then b = 255 Else If b < 0 Then b = 0

    Return color.FromArgb(r, g, b)
  End Function
# ---------- end antisnub ----------
merge = Merge(Data1=mesh, Data2=antisnub.A)  # -> flatten(Result)
mesh_join = MeshJoin(Meshes=merge)
weld_mesh_2 = WeldMesh(Mesh=mesh_join, Angle=3.141592654)
medges = MeshEdges(Mesh=weld_mesh_2)  # -> NakedEdges, InteriorEdges, NonManifoldEdges
merge_2 = Merge(Data1=medges.NakedEdges, Data2=medges.InteriorEdges)  # -> flatten(Result)
merge_3 = Merge(Data1=mesh, Data2=antisnub.A)  # -> flatten(Result)

# ---- group: RH_OUT:mesh
mesh_2 = Mesh(merge_3)

# ---- group: RH_OUT:edges
crv = Curve(merge_2)

# ==== cluster Remap: Remaps numbers
data = ClusterInput()
min = ClusterInput()
max = ClusterInput()
bnd = Bounds(Numbers=data)
dom = ConstructDomain(DomainStart=min, DomainEnd=max)
remap = RemapNumbers(Value=data, Source=bnd, Target=dom)  # -> Mapped, Clipped
R = ClusterOutput(remap.Mapped)
