# Grasshopper definition srf_kmeans.gh (Grasshopper 1.0.7)
# Sample outputs numbers in addition to geometry.

resolution = Slider(30, range=10..30)
dimension = Slider(30, range=10..50)
num_y = GetNumber(Slider(0.5, range=0..1), AtLeast=1, AtMost=2147483647, Maximum=1.797693135e+308, Minimum=-1.797693135e+308)
int_resolution = GetNumber(resolution, AtLeast=1, AtMost=2147483647, Maximum=1.797693135e+308, Minimum=-1.797693135e+308)
int_dimension = GetNumber(dimension, AtLeast=1, AtMost=2147483647, Maximum=1.797693135e+308, Minimum=-1.797693135e+308)
int_k = GetNumber(Slider(10, range=0..20), AtLeast=1, AtMost=2147483647, Maximum=1.797693135e+308, Minimum=-1.797693135e+308)
num_x = GetNumber(Slider(0.5, range=0..1), AtLeast=1, AtMost=2147483647, Maximum=1.797693135e+308, Minimum=-1.797693135e+308)
dom = ConstructDomain(DomainStart=expr("-x/2", int_dimension), DomainEnd=expr("x/2", int_dimension))
pt = ConstructPoint(XCoordinate=num_x, YCoordinate=num_y, ZCoordinate=0)
rectangle = Rectangle(Plane=PlaneXY(0, 0, 0), XSize=dom, YSize=dom, Radius=0)  # -> Rectangle, Length
mplane = MeshPlane(Boundary=rectangle.Rectangle, WidthCount=int_resolution, HeightCount=int_resolution)  # -> Mesh, Area
bbox = BoundingBox(Content=rectangle.Rectangle, Plane=PlaneXY(0, 0, 0))  # -> Box, Box_2
demesh = DeconstructMesh(Mesh=mplane.Mesh)  # -> Vertices, Faces, Colours, Normals
srf = Surface(reparameterize(bbox.Box))
evalsrf = EvaluateSurface(Surface=srf, Point=pt)  # -> Point, Normal, UDirection, VDirection, Frame
pull = PullPoint(Point=demesh.Vertices, Geometry=evalsrf.Point, ClosestOnly=True)  # -> ClosestPoint, Distance
bnd = Bounds(Numbers=pull.Distance)
remap = RemapNumbers(Value=pull.Distance, Source=bnd, Target="1 to 0")  # -> Mapped, Clipped
graph = GraphMapper(remap.Mapped, x0=0, x1=1, y0=0, y1=1, container_name="Bezier", cpx=[0, 0, 0.3742277622, 1], cpy=[0, 0.6380579472, 1, 1])
multiplication = Multiplication(A=graph, B="10")
Z = UnitZ(Factor=multiplication)
addition = Addition(A=demesh.Vertices, B=Z)
conmesh = ConstructMesh(Vertices=addition, Faces=demesh.Faces)
explode_mesh = GhPythonScript(M=conmesh)  # -> M
# ---------- explode_mesh: Python ----------
import Rhino

def meshFromMeshFaces(mesh):
    meshList = []
    for i, face in enumerate(mesh.Faces):

        new_mesh = Rhino.Geometry.Mesh()

        new_mesh.Vertices.Add(mesh.Vertices[face[0]])
        new_mesh.Vertices.Add(mesh.Vertices[face[1]])
        new_mesh.Vertices.Add(mesh.Vertices[face[2]])
        if face.IsQuad: new_mesh.Vertices.Add(mesh.Vertices[face[3]])
        if face.IsTriangle:
            new_mesh.Faces.AddFace(0, 1, 2)
        else:
            new_mesh.Faces.AddFace(0, 1, 2, 3)
        
        new_mesh.Normals.ComputeNormals()
        meshList.append(new_mesh)
    return meshList
    
M = meshFromMeshFaces(M)
# ---------- end explode_mesh ----------
k_means = GhPythonScript(M=flatten(explode_mesh), K=int_k)  # -> out, clusterIndexes; inputs M: list of Mesh, K: Int32
# ---------- k_means: Python ----------
import Rhino.Geometry as rg
import random
import ghpythonlib.treehelpers as th 
import math

def ndistance(a, b):
    """Returns the distance between two n-dimensional vectors"""
    total = 0
    for i in range(len(a)):
        diff = b[i] - a[i]
        total += diff **2
    return math.sqrt(total)

def findnearest(vecs, centroids):
    """Returns the nearest vector among a list of n-dimensional vectors"""
    
    vecs= [list(v[1]) for v in vecs]
    centroids = [list(c[1]) for c in centroids]
    clusters = [[] for c in centroids]
    for j,v in enumerate(vecs):
        closestDist = float("inf")
        closestIndex = 0
        for i,c in enumerate(centroids):
            dist = ndistance(v,c)
            if dist < closestDist : 
                closestDist = dist
                closestIndex = i
                
        clusters[closestIndex].append((j,v))
    clusters = [x for x in clusters if x != []]
    return clusters

def avgvecs(veclist):
    """Returns the avarage vector of a list of n-dimensional vectors"""
    
    veclist = [v[1] for v in veclist]
    trans = map(list, zip(*veclist))
    avgvec = []
    for i in range(len(trans)):
        avgvec.append( sum(trans[i]) / len(trans[i]))
    return (-1,avgvec)

#1. MAKE VECTORS TO ANALYZE ///////////////////////////////////////////////

#make a list where will will store all the n-dimensional vectors. It will be a list of lists
allVectors= []

#we iterate through every mesh with a for loop
for i in range(len(M)):
    #here make a list that will be our n-dimensional vector called nVector
    nVector  =[]

    #for every mesh, we get two lines from oposing vertices
    line1 = rg.Line(M[i].Vertices[0], M[i].Vertices[2])
    line2 = rg.Line(M[i].Vertices[1], M[i].Vertices[3])
    
    #then we store the length of those lines, as our first two dimentions of our nVector
    nVector.append(line1.Length) #dimension 1
    nVector.append(line2.Length) #dimension 2
    
    #next, we find the parameters where each of those lines intersect, per each of the lines
    lli = rg.Intersect.Intersection.LineLine(line1, line2)
    p1 = lli[1]
    p2 = lli[2]
    
    #then we store those parameters as third and fourth dimentions of our nVector
    nVector.append(p1) #third dimension
    nVector.append(p2) #fourth dimension

    #next, we want to get the angle between those vectors
    #for which we need to convert the lines to vectors to calculate the angle
    #we do this using vector substraction (https://www.dummies.com/education/science/physics/how-to-subtract-vectors/)
    v1 = line1.To - line1.From 
    v2 = line2.To - line2.From 
    
    #then, we get the angle from those two vectors
    ang = rg.Vector3d.VectorAngle(v1,v2)
    nVector.append(ang)
    
    allVectors.append(nVector) #append the nVector to a list of allVectors 



#2. K-MEANS ALGORTITHM ///////////////////////////////////////////////

#2.0 add indexes to every vector in the vector list, in order to identify them after clustering
allVectors = [ (i,v) for i,v in enumerate(allVectors) ] #this is called a list comprehension (look it up, if you are interested)

#2.1 find random indexes using random library 
random.seed(1) #we may want to keep the seed consistent, so that the number doesn´t change every time
K_list = random.sample(range(len(M)), K)

#2.2 find some initial random centroids within our ndimensional vectors
centroids = []
for k in K_list:
    centroids.append(allVectors[k])


#2.3 iterate until the condition in the end fulfils (see while loops)
while True:
    

    clusters = findnearest(allVectors, centroids) # findnearest function clusters nvectors to the nearest centroids, and returns a list of clustered nvectors
    
    #then we find new centroids, by averaging all of the vectors in a cluster
    new_centroids = []
    for cluster in clusters:
        
        new_centroid= avgvecs(cluster) #avgvecs function takes a list of nvectors and returns an average nvector
        new_centroids.append(new_centroid) #we store all of the new centroids in a new list of centroids

    #last, we replace the list of centroids, unless the centroids haven´t changed
    if new_centroids == centroids: break #exits the while loop if the new centroids are the same as the old ones
    else: centroids = new_centroids

#2.4 finally, we need to get the item from our nvector list, which will be the identifier for the meshface in the overall mesh
allIndexes = []
for cluster in clusters:
    cluster_indexes =[]
    for nvector in cluster:
        cluster_indexes.append(nvector[0])# we only need to append the index (item 0 of indexAndVector), not the nVector
    allIndexes.append(cluster_indexes)


#output the indexes
clusterIndexes = th.list_to_tree(allIndexes)
# ---------- end k_means ----------
series = Series(Start=0, Step=1, Count=int_k)
item = ListItem(List=explode_mesh, Index=k_means.clusterIndexes, Wrap=True)
gradient = Gradient(
    LowerLimit=0,
    UpperLimit=int_k,
    Parameter=series,
    stops=[0: RGB(243, 57, 0), 0.1: RGB(236, 27, 60), 0.2: RGB(210, 0, 118), 0.3: RGB(103, 0, 120), 0.4: RGB(39, 72, 161), 0.5: RGB(1, 192, 229), 0.6: RGB(18, 178, 90), 0.7: RGB(79, 186, 8), 0.8: RGB(220, 237, 32), 0.9: RGB(247, 159, 20), 1: RGB(243, 57, 0)])
mcol = MeshColours(Mesh=item, Colours=graft(gradient))  # -> flatten(Mesh)
argb = SplitARGB(Colour=graft(gradient), IntegerChannels=True)  # -> Alpha, Red, Green, Blue
preview = CustomPreview(Geometry=item, Material=graft(gradient))
tstat = TreeStatistics(Tree=k_means.clusterIndexes)  # -> Paths, Length, Count
mjoin = MeshJoin(Meshes=mcol)

# ---- group: RH_OUT:mesh_m
mesh = Mesh(mjoin)

# ----
merge = Merge(Data1=argb.Red, Data2=argb.Green, Data3=argb.Blue)
join = TextJoin(Text=[argb.Red, argb.Green, argb.Blue], Join=",")  # -> flatten(Result)

# ---- group: RH_OUT:int_colors
int = Integer(simplify(merge))

# ---- group: RH_OUT:int_cluster_lengths
int_2 = Integer(tstat.Length)

# ----
panel = Panel(int_2)

# ---- group: RH_OUT:str_colors
txt = Text(join)

# ----
panel_2 = Panel(int)
